vi "channel_estimate_MIMO_student.gvi"   [LabVIEW NXG]
inputs:
  "Modulation Parameters In": T6 = {"Modulation Type"="QPSK", "Control Information\nfor Packet Header/Tail"={"Training Sequence 1 (derived)"=[], "Zero Pad Length"=0, "Training Sequence 2 (derived)"=[]}, "RX Oversample Factor"=20, "Synchronization Options"={"Synchronization Method"="Timing Estimation", "Fixed Offset"=0, "Symbol Timing Recovery Method"="Max Energy", "Frame Detection Method"="Sliding Correlator", "Correct Frequency Offset"=FALSE}, "Number of Data Symbols (Derived)"=250, "RX Sample Rate"=4000000, "Pulse Shaping Parameters"={"Modulation Type"="PSK", "Pulse Shaping Filter"="Raised Cosine", "Filter Parameter"=0.5, "Filter Length (Symbols)"=8}, "Channel Estimation/Equalization Parameters"={"Equalization Method"="Direct", "Channel Estimate Length"=4, "Equalizer Length"=4, "Equalizer Delay"=-1}}
  "Input Symbol Sequence 1": c128[]
  "Input Symbol Sequence 2": c128[]
  "error in (no error)": error
outputs:
  "Modulation Parameters Out": T6
  "Channel estimates": T7
  "Mean-Square Error": f64
  "error out": error
types:
  T1 = cluster{"Training Sequence 1 (derived)": c128[], "Zero Pad Length": i32, "Training Sequence 2 (derived)": c128[]}
  T2 = cluster{"Synchronization Method": string, "Fixed Offset": i32, "Symbol Timing Recovery Method": string, "Frame Detection Method": string, "Correct Frequency Offset": bool}
  T3 = enum{"none", "Raised Cosine", "Root Raised Cos", "Gaussian"}
  T4 = cluster{"Modulation Type": enum{"FSK", "PSK", "QAM", "MSK", "PAM", "ASK"}, "Pulse Shaping Filter": T3, "Filter Parameter": f64, "Filter Length (Symbols)": i32}
  T5 = cluster{"Equalization Method": string, "Channel Estimate Length": i32, "Equalizer Length": i32, "Equalizer Delay": i32}
  T6 = cluster{"Modulation Type": string, "Control Information\nfor Packet Header/Tail": T1, "RX Oversample Factor": i32, "Synchronization Options": T2, "Number of Data Symbols (Derived)": i32, "RX Sample Rate": f64, "Pulse Shaping Parameters": T4, "Channel Estimation/Equalization Parameters": T5}
  T7 = cluster{"Element 1": c128[], "Element 2": c128[], "Element 3": c128[], "Element 4": c128[]}
diagram:
  case ($"error in (no error)") {
    frame No Error {
      Property Node(instance in=$"Modulation Parameters In") -> ("Control Information\nfor Packet Header/Tail:Training Sequence 1 (derived)"=w1, "Control Information\nfor Packet Header/Tail:Training Sequence 2 (derived)"=w2, "Channel Estimation/Equalization Parameters:Channel Estimate Length"=w3)
      # L+1
      Decrement(x=w3) -> w4
      Array Subset(array=w1, index0=0, length0=w4) -> w5
      # ligne
      Reverse 1D Array(array=w5) -> (reversed array=w6)
      # Nt
      # t
      Array Size(array=w1) -> (size(s)=w7)
      Subtract(x=w7, y=w4) -> w8
      # colonne
      Array Subset(array=w1, index0=w4, length0=w8) -> w9
      # matrix T
      call "student_toeplitz.gvi"(Row=w6, Column=w9) -> (Toeplitz Array=w10)
      # estimate of the channel 11
      call "student_LLSE.gvi"(A=w10, b=$"Input Symbol Sequence 1")
      # estimate of the channel 21
      call "student_LLSE.gvi"(A=w10, b=$"Input Symbol Sequence 2")
      Array Subset(array=w2, index0=0, length0=w4) -> w11
      Reverse 1D Array(array=w11) -> (reversed array=w12)
      Array Size(array=w2) -> (size(s)=w13)
      Subtract(x=w13, y=w4) -> w14
      Array Subset(array=w2, index0=w4, length0=w14) -> w15
      call "student_toeplitz.gvi"(Row=w12, Column=w15) -> (Toeplitz Array=w16)
      # estimate of the channel 12
      call "student_LLSE.gvi"(A=w16, b=$"Input Symbol Sequence 1")
      # estimate of channel 22
      call "student_LLSE.gvi"(A=w16, b=$"Input Symbol Sequence 2")
    }
    frame Error { }
  }
